# Dynamo graph ALIGN_OFFSET_FINAL.dyn (Dynamo 2.0.2.6826)

select_model_element = DSModelElementSelection()  # nothing selected; graph input
select_edge = DSEdgeSelection()  # nothing selected; graph input
integer_slider = IntegerSlider(1, range=-1..1 step 2)  # graph input
offset = Curve.Offset(curve=select_edge, distance=integer_slider)
setLocation = Element.SetLocation(element=select_model_element, geometry=offset)
