# Dynamo graph BEAM_ORIENTATION.dyn (Dynamo 2.0.2.6826)

code_block = CodeBlock { [0,45]; }
code_block_2 = CodeBlock { 0..50..#10; }
byCoordinates = UV.ByCoordinates(u=code_block, v=code_block_2@L1)
select_face = DSFaceSelection()  # nothing selected; graph input
family_types = FamilyTypes()  # nothing selected; graph input
byParametersOnFace = AdaptiveComponent.ByParametersOnFace(uvs=byCoordinates, surface=select_face, familyType=family_types, lacing=CrossProduct)
