# Dynamo graph CANOPY_BEAMS_TO_REVIT_FINAL_NOW.dyn (Dynamo 2.0.2.6826)

byCenterPointRadius = Circle.ByCenterPointRadius()
select_edge = DSEdgeSelection()  # nothing selected; graph input
planeAtParameter = Curve.PlaneAtParameter(curve=select_edge)
byPlane = CoordinateSystem.ByPlane(plane=planeAtParameter)
transform = Geometry.Transform(geometry=byCenterPointRadius, cs=byPlane)
bySweep = Solid.BySweep(profile=transform, path=select_edge)
file_path = Filename(".\Generic Model.rft")  # graph input
code_block = CodeBlock { "EDGE_BEAM"; }
categories = Categories(index=535)  # graph input
byGeometry = Custom[FamilyInstance.ByGeometry](geometry=bySweep, familyTemplatePath=file_path, familyName=code_block, category=categories)  # You must provide a valid family template path that will be used for all input geometry objects. The project units(and not the templates) will be used to determine the size of the output geometry. The provided category will be used only if the family template supports it. If not, the default template category will be used instead. Likewise, the family material(provided as a string) will be set only if a material with that name exists in the template. If not, the default material will be used instead ("By Category"). For void cuts, the material settings will be ignored. The Subcategory name is an optional input. If you'd like to skip assigning a Subcategory to any new instance, simply use null. The node expects a unique family name for each geometry object. The rest of the input lists will be processed as if the node lacing is set to longest.
