# Dynamo graph CANOPY_BEAM_FINAL.dyn (Dynamo 2.0.2.6826)

select_face = DSFaceSelection()  # nothing selected; graph input
select_model_elements = DSModelElementsSelection()  # nothing selected; graph input
curve = Grid.Curve(grid=select_model_elements)
ZAxis = Vector.ZAxis()
projectInputOnto = Surface.ProjectInputOnto(surface=select_face, geometryToProject=curve, projectionDirection=ZAxis, lacing=Longest)
levels = Levels(index=4)  # graph input
structural_framing_types = StructuralFramingTypes()  # nothing selected; graph input
beamByCurve = StructuralFraming.BeamByCurve(curve=projectInputOnto, level=levels, structuralFramingType=structural_framing_types)
