# Dynamo graph CURVE_POINT_AT_PARAMETER_START_END.dyn (Dynamo 2.0.2.6826)

code_block = CodeBlock { 1; }
byCoordinates = Point.ByCoordinates(x=code_block)
byCoordinates_2 = Point.ByCoordinates()
byStartPointEndPoint = Line.ByStartPointEndPoint(startPoint=byCoordinates, endPoint=byCoordinates_2)
code_block_2 = CodeBlock { 0; }
pointAtParameter = Curve.PointAtParameter(curve=byStartPointEndPoint, param=code_block_2)
pointAtParameter_2 = Curve.PointAtParameter(curve=byStartPointEndPoint, param=code_block)
