# Dynamo graph FLATFRAMING.dyn (Dynamo 2.0.2.6826)

select_model_elements = DSModelElementsSelection()  # nothing selected; graph input
location = StructuralFraming.Location(structuralFraming=select_model_elements)
select_face = DSFaceSelection()  # nothing selected; graph input
ZAxis = Vector.ZAxis()
project = Curve.Project(curve=location, baseGeometry=select_face, projectionDirection=ZAxis, lacing=CrossProduct)
levels = Levels()  # nothing selected; graph input
type = FamilyInstance.Type(familyInstance=select_model_elements)
beamByCurve = StructuralFraming.BeamByCurve(curve=project, level=levels, structuralFramingType=type)
