# Dynamo graph GET_SET_PARAMETERS_FINAL.dyn (Dynamo 2.0.2.6826)

family_types = FamilyTypes()  # nothing selected; graph input
all_elements_of_family_type = ElementsOfFamilyType(Family_Type=family_types)
code_block = CodeBlock { "Base Offset"; }
select_model_element = DSModelElementSelection()  # nothing selected; graph input
getParameterValueByName = Element.GetParameterValueByName(element=select_model_element, parameterName=code_block)
setParameterByName = Element.SetParameterByName(element=all_elements_of_family_type, parameterName=code_block, value=getParameterValueByName, lacing=CrossProduct)
