# Dynamo graph REPEATER_LIMIT_300.dyn (Dynamo 2.0.2.6826)

structural_column_types = StructuralColumnTypes()  # nothing selected; graph input
select_edge = DSEdgeSelection()  # nothing selected; graph input
code_block = CodeBlock { 0..1..0.1; }
pointAtParameter = Curve.PointAtParameter(curve=select_edge, param=code_block)
levels = Levels(index=4)  # graph input
byPointAndLevel = FamilyInstance.ByPointAndLevel(familyType=structural_column_types, point=pointAtParameter, level=levels)
code_block_2 = CodeBlock { "Base Offset"; }
Z = Point.Z(point=pointAtParameter)
setParameterByName = Element.SetParameterByName(element=byPointAndLevel, parameterName=code_block_2, value=Z)
code_block_3 = CodeBlock { "Top Offset"; }
code_block_4 = CodeBlock(z=Z) { z+5; }
setParameterByName_2 = Element.SetParameterByName(element=setParameterByName, parameterName=code_block_3, value=code_block_4)
code_block_5 = CodeBlock { "Top Level"; }
setParameterByName_3 = Element.SetParameterByName(element=setParameterByName, parameterName=code_block_5)  # unwired: value
levels_2 = Levels()  # nothing selected; graph input
setRotation = FamilyInstance.SetRotation()  # unwired: familyInstance, degree
