# Dynamo graph REVIT_WALL_BY_CURVE_AND_HT.dyn (Dynamo 2.0.2.6826)

select_edge = DSEdgeSelection()  # nothing selected; graph input
code_block = CodeBlock { 10; }
levels = Levels(index=4)  # graph input
wall_types = WallTypes()  # nothing selected; graph input
byCurveAndHeight = Wall.ByCurveAndHeight(curve=select_edge, height=code_block, level=levels, wallType=wall_types)
