# Dynamo graph SOLID_SWEEP_PROFILE.dyn (Dynamo 2.0.2.6826)

byCenterPointRadius = Circle.ByCenterPointRadius()
select_model_element = DSModelElementSelection()  # nothing selected; graph input
curves = Element.Curves(element=select_model_element)
planeAtParameter = Curve.PlaneAtParameter(curve=curves)
byPlane = CoordinateSystem.ByPlane(plane=planeAtParameter)
transform = Geometry.Transform(geometry=byCenterPointRadius, cs=byPlane)
bySweep = Solid.BySweep(profile=transform, path=curves)
