# Dynamo graph SURFACE_MULTIPLE_POINTATPARAMETER_LIST_AT_LEVEL_L1_U.dyn (Dynamo 2.0.2.6826)

byWidthLength = Rectangle.ByWidthLength()
byPatch = Surface.ByPatch(closedCurve=byWidthLength)
code_block = CodeBlock { 0..1..0.1; }
code_block_2 = CodeBlock { 0..1..0.1; }
pointAtParameter = Surface.PointAtParameter(surface=byPatch, u=code_block@L1, v=code_block_2)
