# Dynamo graph SURFACE_UVPARAMETER_AT_POINT55.dyn (Dynamo 2.0.2.6826)

byWidthLength = Rectangle.ByWidthLength()
byPatch = Surface.ByPatch(closedCurve=byWidthLength)
byCoordinates = Point.ByCoordinates()
UVParameterAtPoint = Surface.UVParameterAtPoint(surface=byPatch, point=byCoordinates)
