# Dynamo graph TEXT_TO_UPPERCASE_PLAN_VIEW_NAMES.dyn (Dynamo 2.0.2.6826)

element_types = ElementTypes(index=334)  # graph input
all_elements_of_type = ElementsOfType(element_type=element_types)
code_block = CodeBlock { "View Name"; }
getParameterValueByName = Element.GetParameterValueByName(element=all_elements_of_type, parameterName=code_block)
toUpper = String.ToUpper(str=getParameterValueByName)
setParameterByName = Element.SetParameterByName(element=all_elements_of_type, parameterName=code_block, value=toUpper)
