# Dynamo graph TEXT_TO_UPPERCASE_SHEET_NAMES.dyn (Dynamo 2.0.2.6826)

family_types = FamilyTypes()  # nothing selected; graph input
categories = Categories(index=447)  # graph input
all_elements_of_category = ElementsOfCategory(Category=categories)
sheetNumber = Sheet.SheetNumber(sheet=all_elements_of_category)
views = Sheet.Views(sheet=all_elements_of_category)
code_block = CodeBlock { "Sheet Name"; }
setParameterByName = Element.SetParameterByName(element=all_elements_of_category, parameterName=code_block)  # unwired: value
sheetName = Sheet.SheetName(sheet=all_elements_of_category)
toUpper = String.ToUpper(str=sheetName)
