# Dynamo graph BEAMS_AC_LINES.dyn (Dynamo 2.0.2.6826)

family_types = FamilyTypes()  # nothing selected; graph input
all_elements_of_family_type = ElementsOfFamilyType(Family_Type=family_types)
curves = Element.Curves(element=all_elements_of_family_type)
levels = Levels(index=4)  # graph input
structural_framing_types = StructuralFramingTypes()  # nothing selected; graph input
beamByCurve = StructuralFraming.BeamByCurve(curve=curves, level=levels, structuralFramingType=structural_framing_types)
