# Dynamo graph BEAM_AREA_START.dyn (Dynamo 2.0.2.6826)

family_types = FamilyTypes(index=158)  # graph input
all_elements_of_family_type = ElementsOfFamilyType(Family_Type=family_types)
solids = Element.Solids(element=all_elements_of_family_type)
area = Solid.Area(solid=solids)
flatten = List.Flatten(list=area)
sum = Math.Sum(values=flatten)
