# Dynamo graph BMDEPTH_START.dyn (Dynamo 2.0.2.6826)

select_model_element = DSModelElementSelection()  # nothing selected; graph input
value = Dimension.Value(dimension=select_model_element)
select_model_element_2 = DSModelElementSelection()  # nothing selected; graph input
elementType = Element.ElementType(element=select_model_element_2)
parameters = Element.Parameters(element=elementType)
code_block = CodeBlock { "h"; }
code_block_2 = CodeBlock { 2; }
setParameterByName = Element.SetParameterByName(element=elementType, parameterName=code_block, value=code_block_2)
getParameterValueByName = Element.GetParameterValueByName(element=elementType, parameterName=code_block)
