# Dynamo graph CHANGE_BM_TYPE_LOGIC_FINAL.dyn (Dynamo 2.0.2.6826)

categories = Categories(index=535)  # graph input
all_elements_of_category = ElementsOfCategory(Category=categories)
code_block = CodeBlock { "Family and Type"; }
code_block_2 = CodeBlock { "Length"; }
getParameterValueByName = Element.GetParameterValueByName(element=all_elements_of_category, parameterName=code_block_2)
code_block_3 = CodeBlock(l=getParameterValueByName) { (l/24)*12; }
ceiling = Math.Ceiling(number=code_block_3)
code_block_4 = CodeBlock(Min=ceiling) { Min<=12; }
structural_framing_types = StructuralFramingTypes()  # nothing selected; graph input
structural_framing_types_2 = StructuralFramingTypes()  # nothing selected; graph input
if_ = If(test=code_block_4, true=structural_framing_types, false=structural_framing_types_2)
setParameterByName = Element.SetParameterByName(element=all_elements_of_category, parameterName=code_block, value=if_)
