# Dynamo graph COL_CENTERLINE_FINAL.dyn (Dynamo 2.0.2.6826)

select_model_element = DSModelElementSelection()  # nothing selected; graph input
geometry = Element.Geometry(element=select_model_element)
vertices = Face.Vertices(face=geometry)
pointGeometry = Vertex.PointGeometry(vertex=vertices)
byBestFitThroughPoints = Line.ByBestFitThroughPoints(bestFitPoints=pointGeometry)
