# Dynamo graph CUBIOD_EDGE_CURVES.dyn (Dynamo 2.0.2.6826)

byCorners = Cuboid.ByCorners()
edges = Face.Edges(face=byCorners)
curveGeometry = Edge.CurveGeometry(edge=edges)
pointGeometry = Vertex.PointGeometry()  # unwired: vertex
