# Dynamo graph DWG_IMPORT_OR_LINK.dyn (Dynamo 2.0.2.6826)

element_types = ElementTypes(index=160)
all_elements_of_type = ElementsOfType(element_type=element_types)
parameters = Element.Parameters(element=all_elements_of_type)
name = Parameter.Name(parameter=parameters)
code_block = CodeBlock { "Shared Site"; }
contains = List.Contains(list=name, item=code_block, lacing=Longest)
filterByBoolMask = List.FilterByBoolMask(list=all_elements_of_type, mask=contains)
