# Dynamo graph FIREPROOFING_PIPE_MID.dyn (Dynamo 2.0.2.6826)

family_types = FamilyTypes()  # nothing selected; graph input
all_elements_of_family_type = ElementsOfFamilyType(Family_Type=family_types)
faces = Element.Faces(element=all_elements_of_family_type)
code_block = CodeBlock { [1,2]; }
getItemAtIndex = List.GetItemAtIndex(list=faces@L2, index=code_block)
code_block_2 = CodeBlock { 2/12; }
boolean = BoolSelector(false)  # graph input
thicken = Surface.Thicken(surface=getItemAtIndex, thickness=code_block_2, both_sides=boolean)
