# Dynamo graph FIREPROOFING_WIDE_FLANGE_FINAL.dyn (Dynamo 2.0.2.6826)

select_model_element = DSModelElementSelection()  # nothing selected; graph input
faces = Element.Faces(element=select_model_element)
flatten = List.Flatten(list=faces)
code_block = CodeBlock(x=flatten) { x[2..13..1]; }
code_block_2 = CodeBlock { 0.1666666; }
thicken = Surface.Thicken(surface=code_block, thickness=code_block_2)
explode = Geometry.Explode(geometry=thicken)
code_block_3 = CodeBlock { [3,5]; }
getItemAtIndex = List.GetItemAtIndex(list=explode, index=code_block_3, lacing=CrossProduct)
thicken_2 = Surface.Thicken(surface=getItemAtIndex, thickness=code_block_2)
