# Dynamo graph GET_SET_PARAMETERS_LINK_FINAL.dyn (Dynamo 2.0.2.6826)

categories = Categories(index=604)  # graph input
select_model_element = DSModelElementSelection()  # 1 picked in the model; graph input
family_types = FamilyTypes(index=50)  # graph input
all_elements_of_family_type = ElementsOfFamilyType(Family_Type=family_types)
code_block = CodeBlock { "Base Offset"; }
getParameterValueByName = Element.GetParameterValueByName(parameterName=code_block)  # unwired: element
setParameterByName = Element.SetParameterByName(element=all_elements_of_family_type, parameterName=code_block, value=getParameterValueByName, lacing=CrossProduct)
