# Dynamo graph GRIDS_FINAL.dyn (Dynamo 2.0.2.6826)

code_block = CodeBlock { Autodesk.Point.ByCoordinates(0..100..10,0); Autodesk.Point.ByCoordinates(0..100..10,100); }
byStartPointEndPoint = Grid.ByStartPointEndPoint(start=code_block.out1, end=code_block.out0)
