# Dynamo graph NORTH_ARROW.dyn (Dynamo 2.0.2.6826)

select_model_element = DSModelElementSelection()  # nothing selected; graph input
code_block = CodeBlock { "Angle to True North"; }
select_model_element_2 = DSModelElementSelection()  # nothing selected; graph input
getParameterValueByName = Element.GetParameterValueByName(element=select_model_element_2, parameterName=code_block)
setParameterByName = Element.SetParameterByName(element=select_model_element, parameterName=code_block, value=getParameterValueByName)
element_types = ElementTypes(index=334)  # graph input
all_elements_of_type = ElementsOfType(element_type=element_types)
code_block_2 = CodeBlock { "Orientation"; }
getParameterValueByName_2 = Element.GetParameterValueByName(element=all_elements_of_type, parameterName=code_block_2)
