# Dynamo graph ONE_WAY_BEAM_SLAB_SYSTEM_START.dyn (Dynamo 2.0.2.6826)

select_model_element = DSModelElementSelection()  # nothing selected; graph input
elementType = Element.ElementType(element=select_model_element)
code_block = CodeBlock { 0; }
select_model_element_2 = DSModelElementSelection()  # nothing selected; graph input
value = Dimension.Value(dimension=select_model_element_2)

# group: MIN SLAB THICKNESS
code_block_2 = CodeBlock(THICKNESS=value) { (THICKNESS/3)/12+1/12; }
maximumItem = List.MaximumItem(list=code_block_2)

setCompoundLayerWidth = Custom[FamilyType.SetCompoundLayerWidth](familyType=elementType, layerIndex=code_block, width=maximumItem)  # Sets the width of a specified compound layer of a given family type (only applies to family types that have a compound structure, e.g. walls, floors etc.).
