# Dynamo graph PIPE_TOPO_MID.dyn (Dynamo 2.0.2.6826)

code_block = CodeBlock { 1; }
select_model_element = DSModelElementSelection()  # nothing selected; graph input
toPolySurface = Custom[Topography.ToPolySurface](topography=select_model_element)  # Optimized algorithm for converting topographies into polysurfaces. Tested with topographies containing up to 40 000 points. Warning conversions of such mangitudes consume a lot of resources and are sub-optimal. Ensure that you have plenty at least 8GB of ram and patience before attempting such a conversion, otherwise your Dynamo and Revit instances may crash.
select_model_elements = DSModelElementsSelection()  # nothing selected; graph input
curves = Element.Curves(element=select_model_elements)
length = Curve.Length(curve=curves)
code_block_2 = CodeBlock(X=length) { 0..X..6; }
pointAtSegmentLength = Curve.PointAtSegmentLength(curve=curves, segmentLength=code_block_2, lacing=Longest)
code_block_3 = CodeBlock { 150; }
translate = Geometry.Translate(geometry=pointAtSegmentLength, zTranslation=code_block_3)
byStartPointEndPoint = Line.ByStartPointEndPoint(startPoint=pointAtSegmentLength, endPoint=translate)
intersect = Geometry.Intersect(geometry=toPolySurface, other=byStartPointEndPoint)
flatten = List.Flatten(list=intersect)
code_block_4 = CodeBlock { -10; }
translate_2 = Geometry.Translate(geometry=flatten, zTranslation=code_block_4)
restOfItems = List.RestOfItems(list=translate_2)
code_block_5 = CodeBlock { -1; }
dropItems = List.DropItems(list=translate_2, amount=code_block_5)
levels = Levels()  # nothing selected; graph input
element_types = ElementTypes(index=238)  # graph input
all_elements_of_type = ElementsOfType(element_type=element_types)
code_block_6 = CodeBlock(X=all_elements_of_type) { X[0]; }
element_types_2 = ElementTypes(index=236)  # graph input
all_elements_of_type_2 = ElementsOfType(element_type=element_types_2)
watch = Watch(all_elements_of_type_2)
code_block_7 = CodeBlock(X=all_elements_of_type_2) { X[0]; }
