# Dynamo graph PIPE_TOPO_START.dyn (Dynamo 2.0.2.6826)

select_model_element = DSModelElementSelection()  # nothing selected; graph input
toPolySurface = Custom[Topography.ToPolySurface](topography=select_model_element)  # Optimized algorithm for converting topographies into polysurfaces. Tested with topographies containing up to 40 000 points. Warning conversions of such mangitudes consume a lot of resources and are sub-optimal. Ensure that you have plenty at least 8GB of ram and patience before attempting such a conversion, otherwise your Dynamo and Revit instances may crash.
select_model_elements = DSModelElementsSelection()  # nothing selected; graph input
curves = Element.Curves(element=select_model_elements)
