# Dynamo graph PIPE_TOPO_threequarters.dyn (Dynamo 2.0.2.6826)

select_model_element = DSModelElementSelection()  # nothing selected; graph input
toPolySurface = Custom[Topography.ToPolySurface](topography=select_model_element)  # Optimized algorithm for converting topographies into polysurfaces. Tested with topographies containing up to 40 000 points. Warning conversions of such mangitudes consume a lot of resources and are sub-optimal. Ensure that you have plenty at least 8GB of ram and patience before attempting such a conversion, otherwise your Dynamo and Revit instances may crash.
select_model_elements = DSModelElementsSelection()  # nothing selected; graph input
curves = Element.Curves(element=select_model_elements)
length = Curve.Length(curve=curves)
code_block = CodeBlock(length=length) { 0..length..6; }
pointAtSegmentLength = Curve.PointAtSegmentLength(curve=curves, segmentLength=code_block, lacing=Longest)
code_block_2 = CodeBlock { 150; }
translate = Geometry.Translate(geometry=pointAtSegmentLength, zTranslation=code_block_2)
byStartPointEndPoint = Line.ByStartPointEndPoint(startPoint=pointAtSegmentLength, endPoint=translate)
flatten = List.Flatten(list=byStartPointEndPoint)
intersect = Geometry.Intersect(geometry=toPolySurface, other=flatten)
