# Dynamo graph POINT.dyn (Dynamo 2.0.2.6826)

code_block = CodeBlock { 1; }
code_block_2 = CodeBlock { 2; }
code_block_3 = CodeBlock { 3; }
byCoordinates = Point.ByCoordinates(x=code_block, y=code_block_2, z=code_block_3)
