# Dynamo graph PROFILEORDER_FINAL.dyn (Dynamo 2.0.2.6826)

select_model_element = DSModelElementSelection()  # nothing selected; graph input
select_model_element_2 = DSModelElementSelection()  # nothing selected; graph input
select_model_element_3 = DSModelElementSelection()  # nothing selected; graph input
create = List.Create(item0=select_model_element, item1=select_model_element_2, item2=select_model_element_3)
byLoftCrossSections = Form.ByLoftCrossSections(curves=create)
