# Dynamo graph PROPERTYLINES_3D_FINAL.dyn (Dynamo 2.0.2.6826)

select_model_element = DSModelElementSelection()  # nothing selected; graph input
toPolySurface = Custom[Topography.ToPolySurface](topography=select_model_element)  # Optimized algorithm for converting topographies into polysurfaces. Tested with topographies containing up to 40 000 points. Warning conversions of such mangitudes consume a lot of resources and are sub-optimal. Ensure that you have plenty at least 8GB of ram and patience before attempting such a conversion, otherwise your Dynamo and Revit instances may crash.
element_types = ElementTypes(index=246)  # graph input
all_elements_of_type = ElementsOfType(element_type=element_types)
curves = Element.Curves(element=all_elements_of_type)
byJoinedCurves = PolyCurve.ByJoinedCurves(curves=curves)
number_slider = DoubleSlider(-29.9, range=-50..0 step 0.1)  # graph input
offset = Curve.Offset(curve=byJoinedCurves, distance=number_slider)
code_block = CodeBlock(x=byJoinedCurves, y=offset) { [x,y]; }
code_block_2 = CodeBlock { 111; }
extrude = Curve.Extrude(curve=code_block, distance=code_block_2)
intersect = Geometry.Intersect(geometry=toPolySurface, other=extrude)
code_block_3 = CodeBlock(x=intersect) { x[0]; }
byCurve = ModelCurve.ByCurve(curve=code_block_3)
family_types = FamilyTypes()  # nothing selected; graph input
code_block_4 = CodeBlock(x=intersect) { x[1]; }
byJoinedCurves_2 = PolyCurve.ByJoinedCurves(curves=code_block_4)
length = Curve.Length(curve=byJoinedCurves_2)
code_block_5 = CodeBlock(length=length) { 0..length[0]..12; }
pointAtSegmentLength = Curve.PointAtSegmentLength(curve=byJoinedCurves_2, segmentLength=code_block_5, lacing=CrossProduct)
byPoint = FamilyInstance.ByPoint(familyType=family_types, point=pointAtSegmentLength)
