# Dynamo graph REVIT_LINE.dyn (Dynamo 2.0.2.6826)

byCoordinates = Point.ByCoordinates()
code_block = CodeBlock { 1; }
byCoordinates_2 = Point.ByCoordinates(x=code_block, y=code_block, z=code_block)
byStartPointEndPoint = Line.ByStartPointEndPoint(startPoint=byCoordinates, endPoint=byCoordinates_2)
referenceCurveByCurve = ModelCurve.ReferenceCurveByCurve(curve=byStartPointEndPoint)
