# Dynamo graph REVIT_POINT.dyn (Dynamo 2.0.2.6826)

byCoordinates = Point.ByCoordinates()
code_block = CodeBlock { 1; }
byCoordinates_2 = ReferencePoint.ByCoordinates(x=code_block, y=code_block, z=code_block)
