# Dynamo graph REVIT_WALL_BY_FACE_FINAL.dyn (Dynamo 2.0.2.6826)

wall_location = WallLocation(index=0)  # graph input
wall_types = WallTypes()  # nothing selected; graph input
select_face = DSFaceSelection()  # nothing selected; graph input
byFace = Wall.ByFace(locationLine=wall_location, wallType=wall_types, surface=select_face)
