# Dynamo graph SET_TYPE_PARAMETER.dyn (Dynamo 2.0.2.6826)

family_types = FamilyTypes()  # nothing selected
code_block = CodeBlock { "Width"; }
code_block_2 = CodeBlock { 4; }
setParameterByName = Element.SetParameterByName(element=family_types, parameterName=code_block, value=code_block_2)
