# Dynamo graph SOLID_BY_SURFACE_THICKEN.dyn (Dynamo 2.0.2.6826)

code_block = CodeBlock { 1; }
byCoordinates = Point.ByCoordinates(x=code_block)
byCoordinates_2 = Point.ByCoordinates()
byStartPointEndPoint = Line.ByStartPointEndPoint(startPoint=byCoordinates, endPoint=byCoordinates_2)
extrude = Curve.Extrude(curve=byStartPointEndPoint)
thicken = Surface.Thicken(surface=extrude)
boolean = BoolSelector(false)  # graph input
