# Dynamo graph SURFACE_AREA_ROBOT.dyn (Dynamo 2.0.2.6826)

select_model_elements = DSModelElementsSelection()  # nothing selected; graph input
faces = Element.Faces(element=select_model_elements)
flatten = List.Flatten(list=faces)
area = Surface.Area(surface=flatten)
sum = Math.Sum(values=area)
