# Dynamo graph SURFACE_MULTIPLE_POINTATPARAMETER_LACE_LONG.dyn (Dynamo 2.0.2.6826)

byWidthLength = Rectangle.ByWidthLength()
byPatch = Surface.ByPatch(closedCurve=byWidthLength)
code_block = CodeBlock { 0..1..0.1; }
pointAtParameter = Surface.PointAtParameter(surface=byPatch, u=code_block, v=code_block, lacing=CrossProduct)
