# Dynamo graph SURFACE_NORMAL_AT_POINT00.dyn (Dynamo 2.0.2.6826)

byWidthLength = Rectangle.ByWidthLength()
byPatch = Surface.ByPatch(closedCurve=byWidthLength)
byCoordinates = Point.ByCoordinates()
normalAtPoint = Surface.NormalAtPoint(surface=byPatch, point=byCoordinates)
