# Dynamo graph SURFACE_SINGLE_POINTATPARAMETER_00.dyn (Dynamo 2.0.2.6826)

byWidthLength = Rectangle.ByWidthLength()
byPatch = Surface.ByPatch(closedCurve=byWidthLength)
code_block = CodeBlock { 0; }
pointAtParameter = Surface.PointAtParameter(surface=byPatch, u=code_block, v=code_block)
