# Dynamo graph TEXTNOTETESTING.dyn (Dynamo 2.0.2.6826)

select_model_elements = DSModelElementsSelection()  # nothing selected; graph input
byElements = Dimension.ByElements(referenceElements=select_model_elements)  # unwired: view
select_horizontal_text_alignment = HorizontalAlignment(index=1)  # graph input
select_vertical_text_alignment = VerticalAlignment(index=0)  # graph input
horizontalAlignment = TextNote.HorizontalAlignment()  # unwired: textNote
setText = TextNote.SetText()  # unwired: textNote, value
element_types = ElementTypes(index=317)  # graph input
all_elements_of_type = ElementsOfType(element_type=element_types)
text = TextNote.Text(textNote=all_elements_of_type)
select_model_element = DSModelElementSelection()  # nothing selected; graph input
categories = Categories(index=585)  # graph input
all_elements_of_category = ElementsOfCategory(Category=categories)
views = Views(index=17)  # graph input
origin = Point.Origin()
code_block = CodeBlock { "TEXT_FROM_OOTB_DYNAMO_NODES"; }
byLocation = TextNote.ByLocation(view=views, location=origin, text=code_block)  # unwired: alignment
code_block_2 = CodeBlock { "new text"; }
setText_2 = TextNote.SetText(textNote=byLocation, value=code_block_2)
setHorizontalAlignment = TextNote.SetHorizontalAlignment()  # unwired: textNote, value
height = TextNote.Height(textNote=byLocation)
horizontalAlignment_2 = TextNote.HorizontalAlignment(textNote=byLocation)
text_2 = TextNote.Text(textNote=byLocation)
typename = TextNote.Typename(textNote=byLocation)
verticalAlignment = TextNote.VerticalAlignment(textNote=byLocation)
