# Dynamo graph TEXT_TO_UPPERCASE_TEXT_NOTE.dyn (Dynamo 2.0.2.6826)

categories = Categories(index=585)  # graph input
all_elements_of_category = ElementsOfCategory(Category=categories)
text = TextNote.Text(textNote=all_elements_of_category)
toUpper = String.ToUpper(str=text)
setText = TextNote.SetText(textNote=all_elements_of_category, value=toUpper)
