# Dynamo graph dwggrid.dyn (Dynamo 2.0.2.6826)

select_model_element = DSModelElementSelection()  # nothing selected; graph input
curves = Element.Curves(element=select_model_element)
endPoint = Curve.EndPoint(curve=curves)
startPoint = Curve.StartPoint(curve=curves)
byStartPointEndPoint = Grid.ByStartPointEndPoint(start=endPoint, end=startPoint)
