# Dynamo graph dynamotoenscapeanalyticalmodel_start.dyn (Dynamo 2.0.2.6826)

categories = Categories(index=33)  # graph input
all_elements_of_category = ElementsOfCategory(Category=categories)
geometry = Element.Geometry(element=all_elements_of_category)
flatten = List.Flatten(list=geometry)
byCenterPointRadius = Sphere.ByCenterPointRadius(centerPoint=flatten)
byGeometries = ImportInstance.ByGeometries(geometries=byCenterPointRadius)
