# Dynamo graph firEPROOFING_working_optimize_now_02.dyn (Dynamo 2.0.2.6826)

categories = Categories(index=506)  # graph input
all_elements_of_category = ElementsOfCategory(Category=categories)
faces = Element.Faces(element=all_elements_of_category)
code_block = CodeBlock { [2,3,4,5,6,7,8,9,10,11,12,13]; }
getItemAtIndex = List.GetItemAtIndex(list=faces, index=code_block, lacing=CrossProduct)
code_block_2 = CodeBlock { 0.08; }
thicken = Surface.Thicken(surface=getItemAtIndex, thickness=code_block_2)
explode = Geometry.Explode(geometry=thicken)
code_block_3 = CodeBlock { [[[3,5]]]; }
getItemAtIndex_2 = List.GetItemAtIndex(list=explode, index=code_block_3, lacing=CrossProduct)
thicken_2 = Surface.Thicken(surface=getItemAtIndex_2, thickness=code_block_2)
flatten = List.Flatten()  # unwired: list
byGeometry = ImportInstance.ByGeometry()  # unwired: geometry
flatten_2 = List.Flatten()  # unwired: list
byGeometry_2 = ImportInstance.ByGeometry()  # unwired: geometry
byUnion = Solid.ByUnion()  # unwired: solids
code_block_4 = CodeBlock { [x,y]; }  # unwired: x, y
