# Dynamo graph pipe_centerline.dyn (Dynamo 2.0.2.6826)

# note: Multiple creation methods exist for most Solids.  These examples show Closed Profiles as the base, but polysurfaces can be stitched, many primitives are available (Surfaces, Cuboid, Cone, etc)
# note: Geometric Boolean operations (Intersect, Difference, Union, Etc) are available in the Geometry Category.
# note: Tip:  Turn off "Preview" in Node Right Click menus to exclude elements from Showing
# note: Geometry is not the same as a Revit Element:
# Use ImportInstance To create Revit Imports from Surfaces and Solids in any Revit Environment, use Points and Curves to place Family Instances, or create Form in Mass and Generic Model By Point (Adaptive Component) Families

select_model_elements = DSModelElementsSelection()  # nothing selected
faces = Element.Faces(element=select_model_elements)
vertices = Face.Vertices(face=faces)
pointGeometry = Vertex.PointGeometry(vertex=vertices)
byBestFitThroughPoints = Line.ByBestFitThroughPoints(bestFitPoints=pointGeometry)
flatten = List.Flatten(list=vertices)
