# Dynamo graph pipe_centerline2.dyn (Dynamo 2.0.2.6826)

# note: Multiple creation methods exist for most Solids.  These examples show Closed Profiles as the base, but polysurfaces can be stitched, many primitives are available (Surfaces, Cuboid, Cone, etc)
# note: Geometric Boolean operations (Intersect, Difference, Union, Etc) are available in the Geometry Category.
# note: Tip:  Turn off "Preview" in Node Right Click menus to exclude elements from Showing
# note: Geometry is not the same as a Revit Element:
# Use ImportInstance To create Revit Imports from Surfaces and Solids in any Revit Environment, use Points and Curves to place Family Instances, or create Form in Mass and Generic Model By Point (Adaptive Component) Families

select_model_elements = DSModelElementsSelection()  # nothing selected; graph input
categories = Categories(index=350)  # graph input
all_elements_of_category = ElementsOfCategory(Category=categories)
faces = Element.Faces(element=all_elements_of_category)
code_block = CodeBlock { 5; }
getItemAtIndex = List.GetItemAtIndex(list=faces, index=code_block, lacing=CrossProduct)
code_block_2 = CodeBlock { [1,0]; }
pointAtParameter = Surface.PointAtParameter(surface=getItemAtIndex, u=code_block_2, lacing=CrossProduct)
byBestFitThroughPoints = Line.ByBestFitThroughPoints(lacing=CrossProduct)  # unwired: bestFitPoints
