# Dynamo graph revvsdyn.dyn (Dynamo 2.0.2.6826)

code_block = CodeBlock { 0; }
byCoordinates = Point.ByCoordinates(x=code_block, y=code_block, z=code_block)
code_block_2 = CodeBlock { 10; }
byCoordinates_2 = Point.ByCoordinates(x=code_block_2, y=code_block, z=code_block)
byStartPointEndPoint = Line.ByStartPointEndPoint(startPoint=byCoordinates, endPoint=byCoordinates_2)
byLine = Grid.ByLine(line=byStartPointEndPoint)
code_block_3 = CodeBlock { 0; }
byCoordinates_3 = Point.ByCoordinates(x=code_block_3, y=code_block_3, z=code_block_3)
code_block_4 = CodeBlock { 10; }
byCoordinates_4 = Point.ByCoordinates(x=code_block_3, y=code_block_4, z=code_block_3)
byStartPointEndPoint_2 = Line.ByStartPointEndPoint(startPoint=byCoordinates_3, endPoint=byCoordinates_4)
byLine_2 = Grid.ByLine(line=byStartPointEndPoint_2)
select_model_element = DSModelElementSelection()  # nothing selected; graph input
curves = Element.Curves(element=select_model_element)
code_block_5 = CodeBlock { 0; }
pointAtParameter = Curve.PointAtParameter(curve=curves, param=code_block_5)
