# Dynamo graph true beam curve location.dyn (Dynamo 2.0.2.6826)

select_model_element = DSModelElementSelection()  # nothing selected; graph input
location = StructuralFraming.Location(structuralFraming=select_model_element)
ZAxis = Vector.ZAxis()
code_block = CodeBlock { "z Offset Value"; }
getParameterValueByName = Element.GetParameterValueByName(element=select_model_element, parameterName=code_block)
translate = Geometry.Translate(geometry=location, direction=ZAxis, distance=getParameterValueByName)
geometry = Element.Geometry(element=select_model_element)
