# Dynamo graph dynamotoenscapeanalyticalmodel.dyn (Dynamo 2.0.2.6826)

categories = Categories(index=230)  # graph input
byGeometry = DirectShape.ByGeometry(category=categories)  # unwired: geometry
element_types = ElementTypes(index=6)  # graph input
all_elements_of_type = ElementsOfType(element_type=element_types)
curves = Element.Curves(element=all_elements_of_type)
byJoinedCurves = PolyCurve.ByJoinedCurves(curves=curves)
endPoint = Curve.EndPoint(curve=byJoinedCurves)
startPoint = Curve.StartPoint(curve=byJoinedCurves)
code_block = CodeBlock { 0.25; }
byPointsRadius = Cylinder.ByPointsRadius(startPoint=endPoint, endPoint=startPoint, radius=code_block)
categories_2 = Categories(index=33)  # graph input
all_elements_of_category = ElementsOfCategory(Category=categories_2)
geometry = Element.Geometry(element=all_elements_of_category)
flatten = List.Flatten(list=geometry)
byCenterPointRadius = Sphere.ByCenterPointRadius(centerPoint=flatten)
code_block_2 = CodeBlock(x=byPointsRadius, y=byCenterPointRadius) { [x,y]; }
