# Dynamo graph upperupper.dyn (Dynamo 2.0.2.6826)

element_types = ElementTypes(index=334)  # graph input
all_elements_of_type = ElementsOfType(element_type=element_types)
code_block = CodeBlock { "View Name"; }
getParameterValueByName = Element.GetParameterValueByName(element=all_elements_of_type, parameterName=code_block)
toUpper = String.ToUpper(str=getParameterValueByName)
setParameterByName = Element.SetParameterByName(element=all_elements_of_type, parameterName=code_block, value=toUpper)
element_types_2 = ElementTypes(index=338)  # graph input
all_elements_of_type_2 = ElementsOfType(element_type=element_types_2)
code_block_2 = CodeBlock { "Sheet Name"; }
getParameterValueByName_2 = Element.GetParameterValueByName(element=all_elements_of_type_2, parameterName=code_block_2)
toUpper_2 = String.ToUpper(str=getParameterValueByName_2)
setParameterByName_2 = Element.SetParameterByName(element=all_elements_of_type_2, parameterName=code_block_2, value=toUpper_2)
element_types_3 = ElementTypes(index=319)  # graph input
all_elements_of_type_3 = ElementsOfType(element_type=element_types_3)
toUpper_3 = String.ToUpper()  # unwired: str
