# Dynamo graph QueriesRevit.dyn (Dynamo 2.1.0.7500)

# note: Read from Revit: Get Revit parameters
# note: Write to Revit: Create rooms
# note: Write to Revit: Set room information

current = dtDynamo.Workspace.Current()
groups = dtDynamo.Workspace.Groups(workspace=current)
nodes = dtDynamo.Group.Nodes(group=groups)
name = dtDynamo.Node.Name(node=nodes)
name_2 = dtDynamo.Workspace.Name(workspace=current)
getParameterValueByName = Element.GetParameterValueByName()  # frozen; unwired: element, parameterName
setParameterByName = Element.SetParameterByName()  # frozen; unwired: element, parameterName, value
byLocation = Room.ByLocation()  # frozen; unwired: level, location
byElevation = Level.ByElevation()  # frozen; unwired: elevation
# note: Write to Revit: Create levels
byElevationAndName = Level.ByElevationAndName()  # frozen; unwired: elevation, name
byLevelAndOffset = Level.ByLevelAndOffset()  # frozen; unwired: level, offset
byLevelOffsetAndName = Level.ByLevelOffsetAndName()  # frozen; unwired: level, offset, name
elevation = Level.Elevation()  # frozen; unwired: level
name_3 = Level.Name()  # frozen; unwired: level
projectElevation = Level.ProjectElevation()  # frozen; unwired: level
setName = Room.SetName()  # frozen; unwired: room, value
setNumber = Room.SetNumber()  # frozen; unwired: room, value

# group: Read from Revit: Room information
area = Room.Area()  # frozen; unwired: room
centerBoundary = Room.CenterBoundary()  # frozen; unwired: room
coreBoundary = Room.CoreBoundary()  # frozen; unwired: room
coreCenterBoundary = Room.CoreCenterBoundary()  # frozen; unwired: room
finishBoundary = Room.FinishBoundary()  # frozen; unwired: room
height = Room.Height()  # frozen; unwired: room
location = Room.Location()  # frozen; unwired: room
name_4 = Room.Name()  # frozen; unwired: room
number = Room.Number()  # frozen; unwired: room
volume = Room.Volume()  # frozen; unwired: room

# group: Write to Revit: Create parameters
parameterByName = Parameter.ParameterByName()  # frozen; unwired: element, name
createProjectParameter = Parameter.CreateProjectParameter()  # frozen; unwired: parameterName, groupName, type, group, instance, categoryList
createProjectParameterForAllCategories = Parameter.CreateProjectParameterForAllCategories()  # frozen; unwired: parameterName, groupName, type, group, instance
createSharedParameter = Parameter.CreateSharedParameter()  # frozen; unwired: parameterName, groupName, type, group, instance, categoryList
createSharedParameterForAllCategories = Parameter.CreateSharedParameterForAllCategories()  # frozen; unwired: parameterName, groupName, type, group, instance

# group: Write to Revit: Set Revit parameter
setValue = Parameter.SetValue()  # frozen; unwired: parameter, value

# group: Read from Revit: Get parameter information
group = Parameter.Group()  # frozen; unwired: parameter
hasValue = Parameter.HasValue()  # frozen; unwired: parameter
id = Parameter.Id()  # frozen; unwired: parameter
isReadOnly = Parameter.IsReadOnly()  # frozen; unwired: parameter
isShared = Parameter.IsShared()  # frozen; unwired: parameter

# group: Write to Revit: Create walls
byCurveAndHeight = Wall.ByCurveAndHeight()  # frozen; unwired: curve, height, level, wallType
byCurveAndLevels = Wall.ByCurveAndLevels()  # frozen; unwired: c, startLevel, endLevel, wallType

# group: Read from Revit: Wall information
byFace = Wall.ByFace()  # frozen; unwired: locationLine, wallType, surface
wall_location = WallLocation()  # nothing selected; frozen
wall_types = WallTypes()  # nothing selected; frozen

# group: Write to external database
exportCSV = Data.ExportCSV()  # frozen; unwired: filePath, data
exportExcel = Data.ExportExcel()  # frozen; unwired: filePath, sheetName, startRow, startCol, data
writeText = FileSystem.WriteText()  # frozen; unwired: filePath, text
deleteFile = FileSystem.DeleteFile()  # frozen; unwired: path
deleteDirectory = FileSystem.DeleteDirectory()  # frozen; unwired: path
writeToFile = Image.WriteToFile()  # frozen; unwired: path, image

# group: Read from external database
importCSV = Data.ImportCSV()  # frozen; unwired: filePath
importExcel = Data.ImportExcel()  # frozen; unwired: file, sheetName
readText = FileSystem.ReadText()  # frozen; unwired: file
getDirectoryContents = FileSystem.GetDirectoryContents()  # frozen; unwired: directory
readFromFile = Image.ReadFromFile()  # frozen; unwired: file
web_request = WebRequest()  # frozen; unwired: url

# group: Read from Revit: Select Revit elements
categories = Categories()  # nothing selected; frozen
all_elements_of_category = ElementsOfCategory()  # frozen; unwired: Category
element_types = ElementTypes()  # nothing selected; frozen
all_elements_of_type = ElementsOfType()  # frozen; unwired: element_type
family_types = FamilyTypes()  # nothing selected; frozen
all_elements_of_family_type = ElementsOfFamilyType()  # frozen; unwired: Family_Type
select_model_element = DSModelElementSelection()  # nothing selected; frozen
select_model_elements = DSModelElementsSelection()  # nothing selected; frozen

# group: Read from Revit: Level information
levels = Levels()  # nothing selected; frozen

# group: Read from Revit: Get view information
views = Views()  # nothing selected; frozen
all_elements_in_active_view = ElementsInView()  # frozen
filterOverrides = View.FilterOverrides()  # frozen; unwired: view, parameterFilter
isViewTemplate = View.IsViewTemplate()  # frozen; unwired: view
filters = View.Filters()  # frozen; unwired: view

# group: Write to Revit: Create sheets
byNameNumberTitleBlockAndView = Sheet.ByNameNumberTitleBlockAndView()  # frozen; unwired: sheetName, sheetNumber, titleBlockFamilyType, view
byNameNumberTitleBlockAndViews = Sheet.ByNameNumberTitleBlockAndViews()  # frozen; unwired: sheetName, sheetNumber, titleBlockFamilyType, views

# group: Read from Revit: Sheet information
sheetName = Sheet.SheetName()  # frozen; unwired: sheet
sheetNumber = Sheet.SheetNumber()  # frozen; unwired: sheet
views_2 = Sheet.Views()  # frozen; unwired: sheet

# group: Write to Revit: Create views
byLevelAndAreaScheme = AreaPlanView.ByLevelAndAreaScheme()  # frozen; unwired: level, areaScheme
byEyePointAndTarget = AxonometricView.ByEyePointAndTarget()  # frozen; unwired: eyePoint, target
byEyePointTargetAndBoundingBox = AxonometricView.ByEyePointTargetAndBoundingBox()  # frozen; unwired: eyePoint, target, boundingBox
byEyePointTargetAndElement = AxonometricView.ByEyePointTargetAndElement()  # frozen; unwired: eyePoint, target, element
byLevel = CeilingPlanView.ByLevel()  # frozen; unwired: level
byName = DraftingView.ByName()  # frozen; unwired: name
byLevel_2 = FloorPlanView.ByLevel()  # frozen; unwired: level
byEyePointAndTarget_2 = PerspectiveView.ByEyePointAndTarget()  # frozen; unwired: eyePoint, target, element, name, isolateElement
byEyePointTargetAndBoundingBox_2 = PerspectiveView.ByEyePointTargetAndBoundingBox()  # frozen; unwired: eyePoint, target, boundingBox, name, isolateElement
byEyePointTargetAndElement_2 = PerspectiveView.ByEyePointTargetAndElement()  # frozen; unwired: eyePoint, target, element, name, isolateElement
byBoundingBox = SectionView.ByBoundingBox()  # frozen; unwired: box
byCoordinateSystemMinPointMaxPoint = SectionView.ByCoordinateSystemMinPointMaxPoint()  # frozen; unwired: cs, minPoint, maxPoint
byLevel_3 = StructuralPlanView.ByLevel()  # frozen; unwired: level
createUniqueViewName = View3D.CreateUniqueViewName()  # frozen; unwired: name

# group: Write to Revit: Set view information
addFilter = View.AddFilter()  # frozen; unwired: view, parameterFilter
setCategoryOverrides = View.SetCategoryOverrides()  # frozen; unwired: view, category, overrides
setFilterOverrides = View.SetFilterOverrides()  # frozen; unwired: view, parameterFilter, overrides
setScale = View.SetScale()  # frozen; unwired: view

title = dtDynamo.Group.Title(group=groups)
