# Dynamo graph ALIGN_OFFSET_BM_TO_WALL_FINAL.dyn (Dynamo 2.0.2.6826)

# group: BEAM
select_model_element = DSModelElementSelection()  # nothing selected; graph input

# group: WALL
select_model_element_2 = DSModelElementSelection()  # nothing selected; graph input

# group: GETS TOP CENTERLINE OF WALL
solids = Element.Solids(element=select_model_element_2)
explode = Geometry.Explode(geometry=solids)
flatten = List.Flatten(list=explode)
code_block = CodeBlock(X=flatten) { X[2]; }
code_block_2 = CodeBlock { 0; }
code_block_3 = CodeBlock { 0.5; }
pointAtParameter = Surface.PointAtParameter(surface=code_block, u=code_block_2, v=code_block_3)
code_block_4 = CodeBlock { 1; }
code_block_5 = CodeBlock { 0.5; }
pointAtParameter_2 = Surface.PointAtParameter(surface=code_block, u=code_block_4, v=code_block_5)
byStartPointEndPoint = Line.ByStartPointEndPoint(startPoint=pointAtParameter, endPoint=pointAtParameter_2)

setLocation = Element.SetLocation(element=select_model_element, geometry=byStartPointEndPoint)
location = StructuralFraming.Location(structuralFraming=select_model_element)
