# Dynamo graph CURVE_MULTIPLE_POINTS_AT_PARAMETER.dyn (Dynamo 2.0.2.6826)

byCoordinates = Point.ByCoordinates()
code_block = CodeBlock { 1; }
byCoordinates_2 = Point.ByCoordinates(x=code_block)
byStartPointEndPoint = Line.ByStartPointEndPoint(startPoint=byCoordinates, endPoint=byCoordinates_2)
code_block_2 = CodeBlock { 0..1..0.1; }
pointAtParameter = Curve.PointAtParameter(curve=byStartPointEndPoint, param=code_block_2)
