# Dynamo graph CURVE_START_END_POINTS.dyn (Dynamo 2.0.2.6826)

code_block = CodeBlock { 1; }
byCoordinates = Point.ByCoordinates(x=code_block)
byCoordinates_2 = Point.ByCoordinates()
byStartPointEndPoint = Line.ByStartPointEndPoint(startPoint=byCoordinates, endPoint=byCoordinates_2)
startPoint = Curve.StartPoint(curve=byStartPointEndPoint)
endPoint = Curve.EndPoint(curve=byStartPointEndPoint)
