# Dynamo graph FIREPROOFING_PIPE_FINAL.dyn (Dynamo 2.0.2.6826)

family_types = FamilyTypes()  # nothing selected; graph input
all_elements_of_family_type = ElementsOfFamilyType(Family_Type=family_types)
faces = Element.Faces(element=all_elements_of_family_type)
area = Surface.Area(surface=faces)
code_block = CodeBlock { [1,2]; }
getItemAtIndex = List.GetItemAtIndex(index=code_block)  # unwired: list
map = List.Map(list=faces, f_x=getItemAtIndex)
code_block_2 = CodeBlock { 2/12; }
thicken = Surface.Thicken(surface=map, thickness=code_block_2)
categories = Categories(index=512)  # graph input
byGeometry = DirectShape.ByGeometry(geometry=thicken, category=categories)
