# Dynamo graph MESHFAMILYEMBED.dyn (Dynamo 2.0.2.6826)

select_model_elements = DSModelElementsSelection()  # nothing selected; graph input
geometry = Element.Geometry(element=select_model_elements)
string_from_object = FromObject(obj=geometry)
code_block = CodeBlock { "Mesh"; }
contains = List.Contains(list=string_from_object@@L2, item=code_block)
filterByBoolMask = List.FilterByBoolMask(list=select_model_elements, mask=contains)
code_block_2 = CodeBlock(HasMesh=filterByBoolMask.in) { HasMesh; }
code_block_3 = CodeBlock(No_Mesh=filterByBoolMask.out) { No_Mesh; }
