# Dynamo graph PROPERTYLINES_3D_MID.dyn (Dynamo 2.0.2.6826)

select_model_element = DSModelElementSelection()  # nothing selected; graph input
toPolySurface = Custom[Topography.ToPolySurface](topography=select_model_element)  # Optimized algorithm for converting topographies into polysurfaces. Tested with topographies containing up to 40 000 points. Warning conversions of such mangitudes consume a lot of resources and are sub-optimal. Ensure that you have plenty at least 8GB of ram and patience before attempting such a conversion, otherwise your Dynamo and Revit instances may crash.
element_types = ElementTypes(index=246)  # graph input
all_elements_of_type = ElementsOfType(element_type=element_types)
curves = Element.Curves(element=all_elements_of_type)
byJoinedCurves = PolyCurve.ByJoinedCurves(curves=curves)
code_block = CodeBlock { -25; }
offset = Curve.Offset(curve=byJoinedCurves, distance=code_block)
code_block_2 = CodeBlock { 100; }
extrude = Curve.Extrude(curve=offset, distance=code_block_2)
intersect = Geometry.Intersect(geometry=toPolySurface, other=extrude)
flatten = List.Flatten(list=intersect)
byCurve = ModelCurve.ByCurve(curve=flatten)
