# Dynamo graph RAMP_AREA_LINK_START.dyn (Dynamo 2.0.2.6826)

select_model_element = DSModelElementSelection()  # nothing selected; graph input
categories = Categories(index=383)  # graph input
getFromLinkedInstance = Custom[Element.GetFromLinkedInstance](linkInstance=select_model_element, category=categories)  # Extract elements by category from the selected linked instance.; unwired: refresh
faces = Element.Faces(element=getFromLinkedInstance.elements)
code_block = CodeBlock(x=faces) { x[0][3]; }
area = Surface.Area(surface=code_block)
