# Dynamo graph RAMP_AREA_MID.dyn (Dynamo 2.0.2.6826)

select_model_element = DSModelElementSelection()  # nothing selected; graph input
faces = Element.Faces(element=select_model_element)
code_block = CodeBlock(x=faces) { x[3]; }
area = Surface.Area(surface=code_block)
