# Dynamo graph REVIT_WALL_BY_CURVE_AND_HT_MULTIPLE.dyn (Dynamo 2.0.2.6826)

select_model_element = DSModelElementSelection()  # 1 picked in the model
faces = Element.Faces(element=select_model_element)

# group: topsurface
code_block = CodeBlock(x=faces) { x[1]; }

perimeterCurves = Surface.PerimeterCurves(surface=code_block)
integer_slider = IntegerSlider(31, range=0..100 step 1)
levels = Levels(index=0)
wall_types = WallTypes(index=8)
byCurveAndHeight = Wall.ByCurveAndHeight(curve=perimeterCurves, height=integer_slider, level=levels, wallType=wall_types)
