# Dynamo graph REVIT_WALL_BY_CURVE_AND_LV.dyn (Dynamo 2.0.2.6826)

select_edge = DSEdgeSelection()  # nothing selected; graph input
levels = Levels(index=4)  # graph input
levels_2 = Levels(index=5)  # graph input
wall_types = WallTypes()  # nothing selected; graph input
byCurveAndLevels = Wall.ByCurveAndLevels(c=select_edge, startLevel=levels, endLevel=levels_2, wallType=wall_types)
