# Dynamo graph SOLID_BY_SURFACE_THICKEN1_sideNEG.dyn (Dynamo 2.0.2.6826)

code_block = CodeBlock { 1; }
byCoordinates = Point.ByCoordinates(x=code_block)
byCoordinates_2 = Point.ByCoordinates()
byStartPointEndPoint = Line.ByStartPointEndPoint(startPoint=byCoordinates, endPoint=byCoordinates_2)
extrude = Curve.Extrude(curve=byStartPointEndPoint)
code_block_2 = CodeBlock { -1; }
boolean = BoolSelector(false)  # graph input
thicken = Surface.Thicken(surface=extrude, thickness=code_block_2, both_sides=boolean)
