# Dynamo graph SURFACE_BY_CURVE_OFFSET_DEFAULT_DIR.dyn (Dynamo 2.0.2.6826)

code_block = CodeBlock { 1; }
byCoordinates = Point.ByCoordinates(x=code_block)
byCoordinates_2 = Point.ByCoordinates()
byStartPointEndPoint = Line.ByStartPointEndPoint(startPoint=byCoordinates, endPoint=byCoordinates_2)
extrude = Curve.Extrude(curve=byStartPointEndPoint)
