# Dynamo graph SURFACE_NORMAL_AT_PARAMETER55.dyn (Dynamo 2.0.2.6826)

byWidthLength = Rectangle.ByWidthLength()
byPatch = Surface.ByPatch(closedCurve=byWidthLength)
code_block = CodeBlock { 0.5; 0.5; }
normalAtParameter = Surface.NormalAtParameter(surface=byPatch, u=code_block.out0, v=code_block.out1)
