# Dynamo graph SURFACE_SINGLE_POINTATPARAMETER_01.dyn (Dynamo 2.0.2.6826)

byWidthLength = Rectangle.ByWidthLength()
byPatch = Surface.ByPatch(closedCurve=byWidthLength)
code_block = CodeBlock { 0; 1; }
pointAtParameter = Surface.PointAtParameter(surface=byPatch, u=code_block.out0, v=code_block.out1)
