# Dynamo graph UPPERCASEEXAMPLEROOMS.dyn (Dynamo 2.0.2.6826)

categories = Categories(index=425)
all_elements_of_category = ElementsOfCategory(Category=categories)
code_block = CodeBlock { "Name"; }
getParameterValueByName = Element.GetParameterValueByName(element=all_elements_of_category, parameterName=code_block)
string_from_object = FromObject(obj=getParameterValueByName)
toUpper = String.ToUpper(str=string_from_object)
setParameterByName = Element.SetParameterByName(element=all_elements_of_category, parameterName=code_block, value=toUpper)
