# Dynamo graph dynamotoenscapeanalyticalmodel2.dyn (Dynamo 2.0.2.6826)

code_block = CodeBlock { 1; }
categories = Categories(index=33)  # graph input
all_elements_of_category = ElementsOfCategory(Category=categories)
geometry = Element.Geometry(element=all_elements_of_category)
flatten = List.Flatten(list=geometry)
code_block_2 = CodeBlock { 0.5; }
byCenterPointRadius = Sphere.ByCenterPointRadius(centerPoint=flatten, radius=code_block_2)
categories_2 = Categories(index=9)  # graph input
all_elements_of_category_2 = ElementsOfCategory(Category=categories_2)
curves = Element.Curves(element=all_elements_of_category_2)
byJoinedCurves = PolyCurve.ByJoinedCurves(curves=curves)
startPoint = Curve.StartPoint(curve=byJoinedCurves)
endPoint = Curve.EndPoint(curve=byJoinedCurves)
code_block_3 = CodeBlock { 0.25; }
byPointsRadius = Cylinder.ByPointsRadius(startPoint=startPoint, endPoint=endPoint, radius=code_block_3)
code_block_4 = CodeBlock(x=byCenterPointRadius, y=byPointsRadius) { [x,y]; }
categories_3 = Categories(index=5)  # graph input
byGeometry = DirectShape.ByGeometry(geometry=code_block_4, category=categories_3)
