# Dynamo graph dynamotoenscapeanalyticalmodel_final_spheretesting.dyn (Dynamo 2.0.2.6826)

categories = Categories(index=33)  # graph input
all_elements_of_category = ElementsOfCategory(Category=categories)
geometry = Element.Geometry(element=all_elements_of_category)
flatten = List.Flatten(list=geometry)
code_block = CodeBlock { 0.5; }
byCenterPointRadius = Sphere.ByCenterPointRadius(centerPoint=flatten, radius=code_block)
byGeometries = ImportInstance.ByGeometries(geometries=byCenterPointRadius)
element_types = ElementTypes(index=4)  # graph input
all_elements_of_type = ElementsOfType(element_type=element_types)
geometry_2 = Element.Geometry(element=all_elements_of_type)
byJoinedCurves = PolyCurve.ByJoinedCurves(curves=geometry_2)
startPoint = Curve.StartPoint(curve=byJoinedCurves)
endPoint = Curve.EndPoint(curve=byJoinedCurves)
code_block_2 = CodeBlock { 0.1; }
byPointsRadius = Cylinder.ByPointsRadius(startPoint=startPoint, endPoint=endPoint, radius=code_block_2)
byGeometries_2 = ImportInstance.ByGeometries(geometries=byPointsRadius)
intersectAll = Geometry.IntersectAll()  # unwired: geometry, others
distanceTo = Geometry.DistanceTo(geometry=byCenterPointRadius, other=byCenterPointRadius, lacing=CrossProduct)
