# Dynamo graph dynamotoenscapeanalyticalmodel_mid.dyn (Dynamo 2.0.2.6826)

categories = Categories(index=33)  # graph input
all_elements_of_category = ElementsOfCategory(Category=categories)
geometry = Element.Geometry(element=all_elements_of_category)
flatten = List.Flatten(list=geometry)
code_block = CodeBlock { 0.1; }
byCenterPointRadius = Sphere.ByCenterPointRadius(centerPoint=flatten, radius=code_block)
element_types = ElementTypes(index=4)  # graph input
all_elements_of_type = ElementsOfType(element_type=element_types)
curves = Element.Curves(element=all_elements_of_type)
flatten_2 = List.Flatten(list=curves)
startPoint = Curve.StartPoint(curve=flatten_2)
endPoint = Curve.EndPoint(curve=flatten_2)
code_block_2 = CodeBlock { 0.05; }
byPointsRadius = Cylinder.ByPointsRadius(startPoint=startPoint, endPoint=endPoint, radius=code_block_2)
