# Dynamo graph firEPROOFING_working_pipe.dyn (Dynamo 2.0.2.6826)

select_model_element = DSModelElementSelection()  # nothing selected; graph input
faces = Element.Faces(element=select_model_element)
code_block = CodeBlock(x=faces) { [x[1],x[2]]; }
code_block_2 = CodeBlock { 0.1666666; }
thicken = Surface.Thicken(surface=code_block, thickness=code_block_2, lacing=CrossProduct)
flatten = List.Flatten(list=thicken)
byUnion = Solid.ByUnion(solids=flatten)
categories = Categories(index=512)  # graph input
byGeometry = DirectShape.ByGeometry(geometry=byUnion, category=categories)
