# Dynamo graph pipe_centerline+and Ocol_and_duct.dyn (Dynamo 2.0.2.6826)

watch = Watch()  # unwired: arg0
current = Document.Current()
activeView = Document.ActiveView(document=current)
isFamilyDocument = Document.IsFamilyDocument(document=current)
location = Document.Location(document=current)
select_model_element = DSModelElementSelection()  # nothing selected
select_model_element_2 = DSModelElementSelection()  # nothing selected
select_model_element_3 = DSModelElementSelection()  # nothing selected
select_model_element_4 = DSModelElementSelection()  # nothing selected
create = List.Create(item0=select_model_element_2, item1=select_model_element_3, item2=select_model_element_4)
geometry = Element.Geometry(element=create)
vertices = Face.Vertices(face=geometry)
pointGeometry = Vertex.PointGeometry(vertex=vertices)
byBestFitThroughPoints = Line.ByBestFitThroughPoints(bestFitPoints=pointGeometry)
