# Dynamo graph pipe_centerline2true.dyn (Dynamo 2.0.2.6826)

# note: Multiple creation methods exist for most Solids.  These examples show Closed Profiles as the base, but polysurfaces can be stitched, many primitives are available (Surfaces, Cuboid, Cone, etc)
# note: Geometric Boolean operations (Intersect, Difference, Union, Etc) are available in the Geometry Category.
# note: Tip:  Turn off "Preview" in Node Right Click menus to exclude elements from Showing
# note: Geometry is not the same as a Revit Element:
# Use ImportInstance To create Revit Imports from Surfaces and Solids in any Revit Environment, use Points and Curves to place Family Instances, or create Form in Mass and Generic Model By Point (Adaptive Component) Families

byBestFitThroughPoints = Line.ByBestFitThroughPoints(lacing=CrossProduct)  # unwired: bestFitPoints
file_path = Filename("C:\Users\marcellojs\Desktop\Personal\Presentation\Presentation_15_12_03_AUTODESK_UNIVERSITY_2015\03_DYNAMO_FOR_CONTRACTORS\DATASET\05_TOPO_AND_PIPING\pipe_points_01.xlsx")  # graph input
code_block = CodeBlock { "X"; }
code_block_2 = CodeBlock { 0; }
categories = Categories(index=350)  # graph input
all_elements_of_category = ElementsOfCategory(Category=categories)
faces = Element.Faces(element=all_elements_of_category)
code_block_3 = CodeBlock { [0,1]; }
getItemAtIndex = List.GetItemAtIndex(index=code_block_3, lacing=CrossProduct)  # unwired: list
map = List.Map(list=faces, f_x=getItemAtIndex)
code_block_4 = CodeBlock { 0.5; }
pointAtParameter = Surface.PointAtParameter(surface=map, u=code_block_4, v=code_block_4)
X = Point.X(point=pointAtParameter)
exportExcel = Data.ExportExcel(filePath=file_path, sheetName=code_block, startRow=code_block_2, startCol=code_block_2, data=X)
code_block_5 = CodeBlock { "Y"; }
Y = Point.Y(point=pointAtParameter)
exportExcel_2 = Data.ExportExcel(filePath=file_path, sheetName=code_block_5, startRow=code_block_2, startCol=code_block_2, data=Y)
code_block_6 = CodeBlock { "Z"; }
Z = Point.Z(point=pointAtParameter)
exportExcel_3 = Data.ExportExcel(filePath=file_path, sheetName=code_block_6, startRow=code_block_2, startCol=code_block_2, data=Z)
